# Grasshopper definition unnamed.ghx (Grasshopper 1.0.8)

# ---- group: Define values in specific parameters
line = Line()
# Parameters are easily spotted due
# to their black hexagonal icons. All
# parameters store values, usually
# only values of a specific type, such
# as numbers, texts, points or curves.
pt = Point()
# Some parameters can be used to import
# (or reference) objects in the Rhino
# document.
# The 'Curve' parameter for example allows
# you to select existing curves via the
# 'Set One Curve' and 'Set Multiple Curves'
# items in the popup menu.
crv = Curve()

# ----
crv_2 = Curve()

# ---- group: Combine various values according to a formatting rule
formatting_result = Panel([pt, line, crv])

# ----
circle = Circle()
